# Grasshopper definition robarch_assembly_design_exploration.gh (Grasshopper 1.0.7)
# plug-ins: Kangaroo2 Components, TetgenGH

number_slider = Slider(52, range=10..100)
construct_point = ConstructPoint(XCoordinate=number_slider, YCoordinate=number_slider, ZCoordinate=number_slider)
xy_plane = XYPlane(Origin=Point(0, 0, 0))
move = Move(Geometry=xy_plane, Motion=construct_point)  # -> Geometry, Transform
box_2pt = Box2Pt(PointA=xy_plane, PointB=move.Geometry, Plane=PlaneXY(0, 0, 0))
brep = Brep(box_2pt)
volume = Volume(Geometry=brep)  # -> Volume, Centroid
mesh_brep = MeshBrep(
    Brep=brep,
    Settings={GridMaxCount=0, GridMinCount=16, JaggedSeams=False, MaxEdgeLength=0, MinEdgeLength=0.0001, MinTolerance=0, Refine=True, RefineAngle=0, RelativeTolerance=0.65, SimplePlanes=True, Tolerance=0})
refine = Refine(Mesh=mesh_brep, Level=Slider(0, range=0..5))
triangulate = Triangulate(Mesh=refine)  # -> Mesh, Count
mesh = Mesh(triangulate.Mesh)
deconstruct_mesh = DeconstructMesh(Mesh=mesh)  # -> Vertices, simplify(graft(Faces)), Colours, Normals
mesh_edges = MeshEdges(Mesh=mesh)  # -> NakedEdges, InteriorEdges, NonManifoldEdges
output_type = ValueList({"List of tetra meshes": 0, "closed boundary mesh": 1, "Tree of tetra indices": 2, "Tree of edge indices": 3}, selected="Tree of tetra indices")
tetrahedralize = Tetrahedralize(Mesh=mesh, Flags=output_type, MinRatio=Slider(2, range=0.1..2))  # -> Mesh, Indices, Points
mesh_2 = Mesh(tetrahedralize.Mesh)
panel = Panel(mesh_2)
panel_2 = Panel(tetrahedralize.Indices)
volume_2 = Volume(Geometry=mesh_2)  # -> Volume, Centroid
point = Point(volume.Centroid)
point_2 = Point(volume_2.Centroid)
point_3 = Point(tetrahedralize.Points)
vector_2pt = Vector2Pt(PointA=point, PointB=point_2, Unitize=False)  # -> Vector, Length
point_4 = Point([<point referenced from the Rhino model> x8])
list_item = ListItem(List=point_4, Index=Slider(0, range=0..7), Wrap=True)

# ----
# YJ's simple 3 bar
point_5 = Point([Point(280.2906275, -12.24255157, 136.472037), Point(216.2004131, -60.84433544, 48.28341594), Point(288.0668457, 71.76692778, 48.28341594), Point(366.2004131, -60.84433544, 48.28341594)])

# ----
# Yijiang's 12 bar feasible design
point_6 = Point([Point(200.0999806, -36.03747471, 48.28341594), Point(353.0353916, -18.67770667, 48.28341594), Point(261.1829916, 100.9620354, 48.28341594), Point(253.6286279, -26.40318888, 117.6169489), Point(253.7142349, 61.57939256, 131.9623201), Point(311.6618785, 43.28816029, 108.9936051)])

amplitude = Amplitude(Vector=vector_2pt.Vector, Amplitude=Slider(25.7, range=0..100))
mesh_3 = Mesh(mesh_2)
point_7 = Point([<point referenced from the Rhino model> x3])
point_8 = Point([<point referenced from the Rhino model> x3])
point_9 = Point([<point referenced from the Rhino model> x3])
point_10 = Point([<point referenced from the Rhino model> x3])
point_11 = Point([<point referenced from the Rhino model> x3])
point_12 = Point([<point referenced from the Rhino model> x3])
point_13 = Point(point_4)
entwine = Entwine(Branch03=point_7, FlattenInputs=True)  # -> simplify(Result)

move_2 = Move(Geometry=mesh_3, Motion=amplitude)  # -> Geometry, Transform
mesh_edges_2 = MeshEdges(Mesh=move_2.Geometry)  # -> NakedEdges, InteriorEdges, NonManifoldEdges

ghpython_script = GhPythonScript(query_pt=entwine, pts=point_13)  # -> out, ids; inputs query_pt: Point3d, pts: list of Point3d
# ---------- ghpython_script: Python ----------
import rhinoscriptsyntax as rs
import Rhino.Geometry.Plane as Plane
import Rhino.Geometry.Point3d as Point3d
import Rhino.Geometry.Vector3d as Vector3d
import Rhino.Geometry.Quaternion as Quat
import Grasshopper.DataTree as DataTree # Add, AddRange(list, GHPath(i, j))
import Grasshopper.Kernel.Data.GH_Path as GHPath
import System

from ghpythonlib.treehelpers import list_to_tree, tree_to_list

#import json
#from compas.geometry import Frame
#from compas_ghpython import draw_pipes, draw_frame
if query_pt and pts:
    tol = 1e-4
    ids = []
    for id, pt in enumerate(pts):
        if query_pt.DistanceTo(pt) < tol:
            ids.append(id)
# ---------- end ghpython_script ----------

# ----
# Shortest Distance
# Method
ghpython_script_2 = GhPythonScript(full_points_list=point_4)  # -> out, tet_node_ids; inputs full_points_list: list of Point3d
# ---------- ghpython_script_2: Python ----------
import System
import Grasshopper.Kernel.Data.GH_Path as ghpath
import Grasshopper.DataTree as datatree

from compas.geometry import distance_point_point

tet_node_ids = datatree[System.Int32]()
for i, p in enumerate(full_points_list):
    if i > 2:
        nodes = full_points_list[0:i]
        dists = [distance_point_point(full_points_list[i], n) for n in nodes]
        # use distance to previous nodes to sort previous nodes' indices
        nodes_ids = [j for y,j in sorted(zip(dists,range(0,i)))]
        # take the top three nodes
        closest_node_ids = nodes_ids[0:3]
        
        for id in closest_node_ids: tet_node_ids.Add(id, ghpath(i))
# ---------- end ghpython_script_2 ----------

construct_path = ConstructPath(Indices=Slider(3, range=3..10))
tree_branch = TreeBranch(Tree=ghpython_script_2.tet_node_ids, Path=construct_path, MaintainPaths=True)
list_item_2 = ListItem(List=point_4, Index=tree_branch, Wrap=True)
panel_3 = Panel(tree_branch)

clean_tree = CleanTree(RemoveNulls=True, RemoveInvalid=True, RemoveEmpty=True, Tree=ghpython_script.ids)
shift_paths = ShiftPaths(Data=clean_tree, Offset=-1)
panel_4 = Panel(shift_paths)
panel_5 = Panel(ghpython_script_2.tet_node_ids)
integer = Integer(shift_paths)

# ----
# Bar Radius
ideal_radius = Slider(3.18, range=0..50)

# ----
# Bar Visualization
# and Planning
boolean_toggle = BooleanToggle(True)
ghpython_script_3 = PythonScript(points=point_4, tet_point_ids=integer, r=ideal_radius, run=boolean_toggle, use_rpc=Toggle(True), correct=Toggle(True))  # -> out, pts_netw, lns_netw, pts_inv, lns_inv, o_st, b_st; inputs points: list of Point3d, tet_point_ids: tree of Int32, use_rpc: Boolean
# ---------- ghpython_script_3: Python ----------
import System
import Grasshopper.Kernel.Data.GH_Path as ghpath
import Grasshopper.DataTree as datatree
from ghpythonlib.treehelpers import tree_to_list

from compas_ghpython import unload_modules
unload_modules("coop_assembly")

if use_rpc:
    from compas.rpc import Proxy
    geo_gen_execute = Proxy('coop_assembly.geometry_generation.execute', python=python_path, url='http://127.0.0.1')

from compas.geometry import distance_point_point
from compas_ghpython.utilities import draw_network
from compas.datastructures.network import Network
from coop_assembly.geometry_generation.main import main_gh_simple
from coop_assembly.help_functions.drawing import draw_network_inv_gh

dict_nodes = {}
tet_point_lists = tree_to_list(tet_point_ids, lambda x: x)
for i, tet_ids in enumerate(tet_point_lists):
    if tet_ids : dict_nodes[str(i)] = tet_ids
print(dict_nodes)

points = [(p[0], p[1], p[2]) for p in points]

if run:
    print("about to run in ghpython")
    if not use_rpc:
        # xfunc call
        b_st_data, o_st_data = main_gh_simple(points, dict_nodes, r, correct=correct)
    else:
        b_st_data, o_st_data = geo_gen_execute.execute_from_points(
            points, dict_nodes, r, correct=correct)
    
    o_st = Network.from_data(o_st_data)
    b_st = Network.from_data(b_st_data)
    o_st.struct_bar = b_st
    
    pts_new, lns_netw = draw_network(o_st)
    pts_inv, lns_inv, lns_conn  = draw_network_inv_gh(b_st)
# ---------- end ghpython_script_3 ----------
curve = Curve(ghpython_script_3.lns_inv)
bar_picker = Slider(0, range=0..20)
pipe = Pipe(Curve=curve, Radius=ideal_radius, Caps=0)  # -> flatten(Pipe)
panel_6 = Panel(ghpython_script_3.out)
brep_2 = Brep(pipe)
list_item_3 = ListItem(List=brep_2, Index=bar_picker, Wrap=False)
custom_preview = CustomPreview(Geometry=brep_2, Shader=ColourSwatch(SwatchColor=RGBA(99, 247, 237, 168)))
custom_preview_2 = CustomPreview(Geometry=list_item_3, Shader=ColourSwatch(SwatchColor=RGBA(255, 0, 0, 168)))
cluster = Cluster_2(o_struct=ghpython_script_3.o_st, b_struct=ghpython_script_3.b_st, original_bars=brep_2)

# ----
# Robotic setup brep
# (to show the scale)
brep_3 = Brep([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])

# ==== cluster Cluster_2
o_struct = ClusterInput()
b_struct = ClusterInput()
original_bars = ClusterInput()

# ----
# Plane Planning
customized_sequence = Panel("""3
4
5
8
6
7
9
10
11
12
13
14""")  # disabled
integer = Integer()  # disabled
number_slider = Slider(4, range=2..50)  # disabled
number_slider_2 = Slider(4, range=2..50)  # disabled
boolean_toggle = BooleanToggle(False)  # disabled
number_slider_3 = Slider(20, range=0..100)  # disabled
number_slider_4 = Slider(20, range=0..100)  # disabled
ghpython_script = GhPythonScript(
    o_struct=o_struct,
    b_struct=b_struct,
    nb_rot=number_slider,
    nb_trans=number_slider_2,
    flip=boolean_toggle,
    offset_d1=number_slider_3,
    offset_d2=number_slider_4,
    customized_seq=integer)  # -> out, planes, planes_offset, simplify(planes_out), planes_out_offset, sequeneced_element_ids; inputs nb_rot: Int32, nb_trans: Int32, flip: Boolean, customized_seq: list of Int32; disabled
# ---------- ghpython_script: Python ----------
from compas_ghpython import unload_modules
import coop_assembly
unload_modules("coop_assembly")
from coop_assembly.assembly_info_generation.fabrication_planes import calculate_gripping_plane, calculate_offset, calculate_offsets_all

import Rhino.Geometry as rg
from ghpythonlib.treehelpers import list_to_tree


#from coop_assembly.assembly_info_generation.fabrication_planes import calculate_gripping_plane, calculate_offset

if customized_seq:
    seq = [0,1,2] + customized_seq
else:
    seq = [v for v in b_struct.vertex]

print seq

for v in b_struct.vertex:
    calculate_gripping_plane(b_struct, v, b_struct.vertex[v]["mean_point"], nb_rot=nb_rot, nb_trans=nb_trans, planes_flip=flip)
    calculate_offset(o_struct, b_struct, v, offset_d1, offset_d2, seq)
    calculate_offsets_all(o_struct, b_struct, v, offset_d1, offset_d2, seq)


planes = []
for v in b_struct.vertex:
    gp = b_struct.vertex[v]["gripping_plane"]
    pl = rg.Plane(rg.Point3d(gp[0][0], gp[0][1],gp[0][2]), rg.Vector3d(gp[1][0], gp[1][1],gp[1][2]), rg.Vector3d(gp[2][0], gp[2][1],gp[2][2]))
    planes.append(pl)

planes_all = []
for i,v in enumerate(b_struct.vertex):
    gp_all = b_struct.vertex[v]["gripping_planes_all"]
    planes_all.append([])
    for gp in gp_all:
        pl = rg.Plane(rg.Point3d(gp[0][0], gp[0][1],gp[0][2]), rg.Vector3d(gp[1][0], gp[1][1],gp[1][2]), rg.Vector3d(gp[2][0], gp[2][1],gp[2][2]))
        planes_all[i].append(pl)

planes_offset = []
for v in b_struct.vertex:
    gp = b_struct.vertex[v]["gripping_plane_offset"]
    pl = rg.Plane(rg.Point3d(gp[0][0], gp[0][1],gp[0][2]), rg.Vector3d(gp[1][0], gp[1][1],gp[1][2]), rg.Vector3d(gp[2][0], gp[2][1],gp[2][2]))
    planes_offset.append(pl)

planes_offset_all = []
for i,v in enumerate(b_struct.vertex):
    gp_all = b_struct.vertex[v]["gripping_planes_offset_all"]
    planes_offset_all.append([])
    for gp in gp_all:
        pl = rg.Plane(rg.Point3d(gp[0][0], gp[0][1],gp[0][2]), rg.Vector3d(gp[1][0], gp[1][1],gp[1][2]), rg.Vector3d(gp[2][0], gp[2][1],gp[2][2]))
        planes_offset_all[i].append(pl)

planes_out = list_to_tree(planes_all)
planes_out_offset = list_to_tree(planes_offset_all)
sequeneced_element_ids = seq
# ---------- end ghpython_script ----------
panel = Panel(ghpython_script.out)  # disabled
plane = Plane(simplify(ghpython_script.planes_out))  # disabled
plane_2 = Plane(simplify(ghpython_script.planes_out_offset))  # disabled
pln = Plane(ghpython_script.planes)  # disabled
pln_2 = Plane(ghpython_script.planes_offset)  # disabled
integer_2 = Integer(ghpython_script.sequeneced_element_ids)  # disabled
cluster = Cluster(plane=plane_2)  # disabled

original_bars_2 = Brep(original_bars)  # disabled
plane_3 = Plane(pln)  # disabled
plane_4 = Plane(pln_2)  # disabled
number_slider_5 = Slider(5, range=0..7)  # disabled

# ---- group: offseted bars
orient = Orient(Geometry=original_bars_2, Source=plane_3, Target=plane_4)  # -> Geometry, Transform; disabled

# ----
# TCP Transformation
cluster_2 = Cluster(plane=plane)  # disabled

split_list = SplitList(List=original_bars_2, Index=number_slider_5)  # -> ListA, ListB; disabled
list_item = ListItem(List=orient.Geometry, Index=number_slider_5, Wrap=True)  # disabled
list_item_2 = ListItem(List=original_bars_2, Index=number_slider_5, Wrap=True)  # disabled
colour_swatch = ColourSwatch(SwatchColor=RGBA(77, 87, 86, 168))  # disabled
brep = Brep(split_list.ListA)  # disabled
colour_swatch_2 = ColourSwatch(SwatchColor=RGBA(42, 255, 0, 168))  # disabled
colour_swatch_3 = ColourSwatch(SwatchColor=RGBA(255, 0, 0, 168))  # disabled
custom_preview = CustomPreview(Geometry=list_item_2, Shader=colour_swatch_2)  # disabled
custom_preview_2 = CustomPreview(Geometry=brep, Shader=colour_swatch)  # disabled
custom_preview_3 = CustomPreview(Geometry=list_item, Shader=colour_swatch_3)  # disabled

# ==== cluster Cluster
plane = ClusterInput()

# ---- group: gripping plane generation
plane_2 = Plane(simplify(plane))

# ----
deconstruct_plane = DeconstructPlane(Plane=plane_2)  # -> Origin, XAxis, YAxis, ZAxis
negative = Negative(Value=deconstruct_plane.ZAxis)
construct_plane = ConstructPlane(Origin=deconstruct_plane.Origin, XAxis=deconstruct_plane.YAxis, YAxis=negative)
plane_3 = ClusterOutput(construct_plane)
