# Grasshopper definition 180301_TetrasFromPoints_yijiangh.ghx (Grasshopper 1.0.7)

pt = Point([Point(866.0254038, 500, 0), Point(0, 0, 0), Point(0, 1000, 0), Point(288.6751372, 500, 818.0845002), Point(769.6337056, 1333.044681, 544.743266), Point(-160.7079199, 1388.887161, 907.1602668), Point(117.857296, 1981.433204, 151.3225811), Point(-798.2007826, 1580.502237, 160.9119753), Point(-560.7009386, 2300.548402, 812.9298774), Point(-666.6550298, 2519.435402, -176.5365207), Point(58.74232409, 2934.6909, 527.6795127)])
item = ListItem(List=pt, Index=Slider(0, range=0..11), Wrap=True)
dom = ConstructDomain(DomainStart=Slider(0, range=0..100), DomainEnd=Slider(10, range=0..100))
subset = SubList(List=pt, Domain=dom, Wrap=True)  # -> List, Index
python = PythonScript(points=subset.List, y=Toggle(True))  # -> out, pts_netw, lns_netw, pts_inv, lns_inv, o_st, b_st; inputs points: list of Point3d
# ---------- python: Python ----------
import pickle
import random

from compas_ghpython import unload_modules
unload_modules("lws_geometry")
unload_modules("coop_assembly")
unload_modules("compas_fab")
unload_modules("core")

from compas.utilities.xfunc import XFunc
from compas_ghpython.artists import NetworkArtist
from compas_ghpython.utilities.drawing import draw_network

#from lws_geometry.geometry_generation.execute_compas import execute_from_points, execute_from_points_optimise
#from lws_geometry.geometry_generation.draw_compas import draw_network_inv_gh, draw_structure_gh
#from lws_geometry.geometry_generation.main_compas import main_gh, main_gh_simple, main_gh_discrete
from coop_assembly.geometry_generation import main_gh_simple
from compas.geometry.distance import distance_point_point

dict_nodes = {}
for i,p in enumerate(points):
    if i > 2:
        nodes       = points[0:i]
        dists       = [distance_point_point(points[i], n) for n in nodes]
        nodes_inds  = [j for y,j in sorted(zip(dists,range(0,i)))] 
        nodes_fin = nodes_inds[0:3]
        
        dict_nodes[str(i)]= nodes_fin

points = [(p[0], p[1], p[2]) for p in points]

supports_bars = [(0,1), (1,2), (2,0)]
supports_nodes = [0, 1, 2, 4]
load_bars = [(4,5)]

load = (0,0,-2000)
print("about to run")
data = main_gh_simple(points, dict_nodes, supports_nodes, supports_bars, load_bars, load)

o_st = data[1]
b_st = data[0]

pts_new, lns_netw = draw_network(o_st)
pts_inv, lns_inv, lns_conn  = draw_network_inv_gh(b_st)
# ---------- end python ----------

# ----
# b_st
# This is the base datastructure that contains all information.
#  It is an inverted network in which each bar is represented
# by a vertex and each connection between two bars by an edge.
# The datastructure class is called Bar_Structure and is in
# the spatial_structures module.
panel = Panel(python.b_st)

panel_2 = Panel(python.out)
line = Line(python.lns_netw)
line_2 = Line(python.lns_inv)
pipe = Pipe(Curve=python.lns_inv, Radius=Slider(12.5, range=0..100), Caps=0)
item_2 = ListItem(List=line_2, Index=Slider(3, range=0..50), Wrap=True)
pt_2 = Point(python.pts_netw)
preview = CustomPreview(Geometry=pipe, Shader=ColourSwatch(SwatchColor=RGBA(61, 200, 255, 168)))
item_3 = ListItem(List=pt_2, Index=Slider(3, range=0..20), Wrap=True)
